# Grasshopper definition 04_motion_program.ghx (Grasshopper 1.0.8)
# plug-ins: Motus
# Motion program: PTP + LIN + CIRC + SET gripper (via Merge) -> Motus Program -> Preview / Export. Auto Plan on; drag Motus Scrub or Play.

# ----
# 04 · Motion program
# One row per move → Merge → Program. Auto Plan on; scrub when Status OK.
# Robot
ur10e = MotusUR10eRobotiq()
joints = MotusJointState(Joints=[0, -0.5, 1, -1, 0, 0])

# ----
# Env + Traj
joints_2 = MotusJointState(Joints=[1.2, -1, 1.2, -1.6, -1.5708, 0])
Z = UnitZ()
goalpt = ConstructPoint(X=0.45, Y=0.15, Z=0.45)
goalpt_2 = ConstructPoint(X=0.453, Y=0.152, Z=0.45)
goalpt_3 = ConstructPoint(X=0.45, Y=0.154, Z=0.45)
toolstate = MotusToolState(Tool=ur10e, Width=0.085, Speed=0.5, Force=0.5, ToolStatePreset="Closed", CanvasPivotX=288, CanvasPivotY=772)
pl = PlaneNormal(Origin=goalpt, ZAxis=Z)
pl_2 = PlaneNormal(Origin=goalpt_2, ZAxis=Z)
pl_3 = PlaneNormal(Origin=goalpt_3, ZAxis=Z)
toolstate_2 = MotusToolState(Tool=ur10e, Width=0.085, Speed=0.5, Force=0.5, ToolStatePreset="Open", CanvasPivotX=448, CanvasPivotY=172)
move = MotusMove(
    Type="PTP",
    Goal=joints_2,
    Blend=0,
    ToolState=toolstate_2,
    MotionType="PTP",
    ToolMode="Hold",
    CanvasPivotX=637,
    CanvasPivotY=172)
move_2 = MotusMove(Type="LIN", Goal=pl, Blend=0, Step=0.005, MotionType="LIN", ToolMode="Hold", CanvasPivotX=637, CanvasPivotY=422)
move_3 = MotusMove(
    Type="CIRC",
    Goal=pl_3,
    Blend=0,
    Via=pl_2,
    Samples=16,
    MotionType="CIRC",
    ToolMode="Hold",
    CanvasPivotX=637,
    CanvasPivotY=612)
move_4 = MotusMove(Type="SET", ToolState=toolstate, Duration=0.2, MotionType="SET", ToolMode="Hold", CanvasPivotX=637, CanvasPivotY=762)
merge = Merge(Data1=move, Data2=move_2, Data3=move_3, Data4=move_4)

# ----
# Plan
program = MotusProgram(Robot=ur10e, Segments=merge, Start=joints, AutoPlan=True)  # -> Trajectory, Status, Warnings

# ----
# Play
scrub = Slider(0, range=0..1)
preview = MotusPreview(
    Trajectory=program.Trajectory,
    ShowStart=True,
    Position=scrub,
    ColorMode=0,
    ShowCustomColors=False,
    ShowDebugOutputs=False)  # -> Meshes, Links, TCPPath, State, Time
export = MotusExport(Trajectory=program.Trajectory, Retime=True, Validate=False, Retimer="TotgLite")  # -> Json, Csv, Validation
