# Grasshopper definition 10_pick_place.ghx (Grasshopper 1.0.8)
# plug-ins: Motus
# UR10e pick-and-place: 3× Motus Program (approach / carry+Attach / retract) with Tr0 chaining → Preview. Auto Plan on.

# ---- group: Robot + home TCP
# 10  Pick & place
ur10e = MotusUR10eRobotiq()
joints = MotusJointState(Joints=[0, -1.5708, 1.5708, 0, 1.5708, 0])
tcp = MotusTCPPose(Robot=ur10e, State=joints)

# ---- group: Workpiece + Attach
Z = UnitZ()
goalpt = ConstructPoint(X=0.8514, Y=0.1741, Z=0.6136)
pl = PlaneNormal(Origin=goalpt, ZAxis=Z)
colbox = MotusCollisionBox(Plane=pl, HalfX=0.03, HalfY=0.03, HalfZ=0.03, Name="workpiece")
colscene = MotusCollisionScene(Objects=colbox)  # -> Scene, Groups, EndEffectors
# Note: Approach → carry (Attach) → retract. Tr0 chains Programs. SET jaws ≠ Attach payload.
attach = MotusAttachBody(Object=colbox, Name="workpiece", GraspTcp=tcp, SourceName="workpiece")

# ---- group: Place/retract offsets
deplane = DeconstructPlane(Plane=tcp)  # -> Origin, XAxis, YAxis, ZAxis
X = UnitX()
Y = UnitY()
Z_2 = UnitZ()
amp = Amplitude(Vector=X, Amplitude=-0.05)
amp_2 = Amplitude(Vector=Y, Amplitude=0.05)
amp_3 = Amplitude(Vector=Z_2, Amplitude=0.1)
move = Move(Geometry=deplane.Origin, Translation=amp)
move_2 = Move(Geometry=move, Translation=amp_2)
pl_2 = ConstructPlane(Origin=move_2, XAxis=deplane.XAxis, YAxis=deplane.YAxis)
move_3 = Move(Geometry=move_2, Translation=amp_3)
pl_3 = ConstructPlane(Origin=move_3, XAxis=deplane.XAxis, YAxis=deplane.YAxis)

# ---- group: Approach Program
toolstate = MotusToolState(Tool=ur10e, Width=0.06, Speed=0.5, Force=0.5, ToolStatePreset="Custom", CanvasPivotX=568, CanvasPivotY=438)
move_4 = MotusMove(Type="LIN", Goal=tcp, Blend=0, Step=0.005, MotionType="LIN", ToolMode="Hold", CanvasPivotX=728, CanvasPivotY=364)
move_5 = MotusMove(Type="SET", ToolState=toolstate, Duration=0, MotionType="SET", ToolMode="Hold", CanvasPivotX=737, CanvasPivotY=442)
merge = Merge(Data1=move_4, Data2=move_5)
program = MotusProgram(Robot=ur10e, Segments=merge, Collision=colscene.Scene, AutoPlan=True)  # -> Trajectory, Status, Warnings

# ---- group: Carry Program
toolstate_2 = MotusToolState(Tool=ur10e, Width=0.085, Speed=0.5, Force=0.5, ToolStatePreset="Open", CanvasPivotX=568, CanvasPivotY=392)
move_6 = MotusMove(Type="SET", ToolState=toolstate, Duration=0, MotionType="SET", ToolMode="Hold", CanvasPivotX=737, CanvasPivotY=487)
move_7 = MotusMove(Type="LIN", Goal=pl_2, Blend=0, Step=0.005, MotionType="LIN", ToolMode="Hold", CanvasPivotX=737, CanvasPivotY=562)
move_8 = MotusMove(Type="SET", ToolState=toolstate_2, Duration=0, MotionType="SET", ToolMode="Hold", CanvasPivotX=737, CanvasPivotY=597)
merge_2 = Merge(Data1=move_6, Data2=move_7, Data3=move_8)
program_2 = MotusProgram(Robot=ur10e, Segments=merge_2, Collision=colscene.Scene, Attach=attach, Prior=program.Trajectory, AutoPlan=True)  # -> Trajectory, Status, Warnings

# ---- group: Retract Program
move_9 = MotusMove(Type="LIN", Goal=pl_3, Blend=0, Step=0.005, MotionType="LIN", ToolMode="Hold", CanvasPivotX=737, CanvasPivotY=742)
program_3 = MotusProgram(Robot=ur10e, Segments=move_9, Collision=colscene.Scene, Prior=program_2.Trajectory, AutoPlan=True)  # -> Trajectory, Status, Warnings

# ---- group: Preview
merge_3 = Merge(Data1=program.Trajectory, Data2=program_2.Trajectory, Data3=program_3.Trajectory)
scrub = Slider(0, range=0..1)
preview = MotusPreview(
    Trajectory=merge_3,
    ShowStart=True,
    Position=scrub,
    Scene=colscene.Scene,
    ColorMode=0,
    ShowCustomColors=False,
    ShowDebugOutputs=False)  # -> Meshes, Links, TCPPath, State, Time
